# Grasshopper definition minimum_spanning_tree.ghx (Grasshopper 1.0.7)
# plug-ins: Bifocals

# Exercises
# 
# 
# . Create your own volume to contain a minimum spanning tree
# 
# . Create different region of high/low vertices density
# 
# . Display the points and change their colors based on connectivity
number_slider = Slider(18, range=0..100)
cone = Cone(Base=PlaneXY(0, 0, 0), Radius=number_slider, Length=Slider(80, range=0..100))  # -> Cone, Tip
cap = CapHoles(Brep=cone.Cone)
xy = XYPlane(Origin=cone.Tip)
sph = Sphere(Base=xy, Radius=Slider(36, range=0..100))  # -> graft(Sphere)
pop3d = Populate3D(Region=cone.Cone, Count=Slider(1000, range=0..3000), Seed=1)
pop3d_2 = Populate3D(Region=sph, Count=Slider(300, range=0..1000), Seed=1)
brepsinc = PointInBreps(Brep=cap, Point=pop3d, Strict=False)  # -> Inside, Index
brepsinc_2 = PointInBreps(Brep=sph, Point=pop3d_2, Strict=False)  # -> Inside, Index
dispatch = Dispatch(List=pop3d, DispatchPattern=brepsinc.Inside)  # -> ListA, ListB
dispatch_2 = Dispatch(List=pop3d_2, DispatchPattern=brepsinc_2.Inside)  # -> ListA, ListB
merge = Merge(Data1=flatten(dispatch.ListA), Data2=flatten(dispatch_2.ListA))

# ---- group: MinimumSpanningTree
python = GhPythonScript(pts=merge, startIndex=Slider(44, range=0..100))  # -> out, a, b; inputs pts: list of Point3d, startIndex: Int32
# ---------- python: Python ----------
import Rhino.Geometry as rg
import ghpythonlib.treehelpers as th

"""
Based on Prim's algorithm
https://en.wikipedia.org/wiki/Prim%27s_algorithm

"""

def minimSpanTr(pts, startIndex):
    connections = []
    reached_keys = []
    unreached_keys = [i for i in range(len(pts))]
    reached_keys.append(unreached_keys.pop(startIndex))
    
    i = 0
    
    while i < len(pts)-1:
        i += 1
        dist = 'inf'
        besCombo = None
        
        for rkey in reached_keys:
            for ukey in unreached_keys:
                d = rg.Point3d.DistanceTo(pts[rkey], pts[ukey])
                
                if d < dist:
                    dist = d
                    bestCombo = [rkey, ukey]
        
        connections.append(bestCombo)
        reached_keys.append(bestCombo[1])
        unreached_keys.remove(bestCombo[1])
    
    return connections

connected_keys = minimSpanTr(pts, startIndex)

fc_keys = [index for duets in connected_keys for index in duets]
pts_connects = [fc_keys.count(i) for i in range(len(pts))]

a = th.list_to_tree([rg.Line(pts[i], pts[j]) for [i,j] in connected_keys])
b = [pts_connects[i]-1 + pts_connects[j]-1 for [i,j] in connected_keys]
#c = pts_connects
# ---------- end python ----------

# ----
bnd = Bounds(Numbers=python.b)
dedomain = DeconstructDomain(Domain=bnd)  # -> Start, End
gradient = Gradient(
    LowerLimit=dedomain.Start,
    UpperLimit=dedomain.End,
    Parameter=python.b,
    stops=[0: RGB(80, 55, 25), 0.409: RGB(255, 0, 0), 0.912: RGB(255, 255, 192)])
preview = CustomPreview(Geometry=graft(python.a), Material=graft(gradient))
