# Grasshopper definition random_walker.ghx (Grasshopper 1.0.7)
# plug-ins: Bifocals

# Exercises
# 
# 
# . Create multiples walkers and update them all in a for-loop
# 
# . Generate boundaries to contain the walkers
# 
# . Base the pixels color on their spatial locations
# 
# . Add a 'bias' in the random walking that steers the walker in a certain direction
# 
# . Add diagonal (or other creative) steps
number_slider = Slider(6, range=0..10)
# Show how to animate slider to create a short animation. Use ffmpeg to turn it into a video.
size = Slider(2.8, range=0..10)
python = GhPythonScript(seed=number_slider, time=Slider(3000, range=1..3000), size=size)  # -> out, boxes, pts; inputs seed: Int32, time: Int32
# ---------- python: Python ----------
import Rhino.Geometry as rg
import random as r
r.seed(seed)

class Walker():
    
    """Random Walk Python Class
    https://en.wikipedia.org/wiki/Random_walk
    """
    
    def __init__(self, x, y, z):
        self.x = x
        self.y = y
        self.z = z
        
        self.path_pts = []
        self.path_boxes = []
    
    def update_path(self):
        pt = rg.Point3d(self.x, self.y, self.z)
        dom = rg.Interval(-size/2, size/2)
        rct = rg.Box(rg.Plane(pt, rg.Vector3d(0,0,1)), dom, dom, dom)
        msh = rg.Mesh.CreateFromBox(rct, 1, 1, 1)
        
        self.path_pts.append(pt)
        self.path_boxes.append(msh)
    
    def move_cartesian(self):
        choice = r.randint(0,5)
        if choice == 0:
            self.x += size
        elif choice == 1:
            self.x -= size
        elif choice == 2:
            self.y += size
        elif choice == 3:
            self.y -= size
        elif choice == 4:
            self.z += size
        else:
            self.z -= size
            
    def move_messy(self):
        stepX = r.uniform(-1,1)
        self.x += stepX
        stepY = r.uniform(-1,1)
        self.y += stepY
        stepZ = r.uniform(-1,1)
        self.z += stepZ
        

w = Walker(0,0,0)
for t in range(time):
    w.move_cartesian()
    #w.move_messy()
    w.update_path()


pts = w.path_pts
boxes = w.path_boxes
# ---------- end python ----------
lng = ListLength(List=python.boxes)
pt = Point(python.pts)
intcrv = Interpolate(Vertices=pt, Degree=3, Periodic=False, KnotStyle=1)  # -> Curve, Length, Domain
series = Series(Start=0, Step=1, Count=lng)
gradient = Gradient(
    LowerLimit="0",
    UpperLimit=lng,
    Parameter=series,
    stops=[0: RGB(0, 98, 0), 0.25: RGB(81, 175, 17), 0.5: RGB(159, 198, 146), 0.75: RGB(170, 235, 41), 1: RGB(221, 255, 53)])
mcol = MeshColours(Mesh=graft(python.boxes), Colours=graft(gradient))
medges = MeshEdges(Mesh=mcol)  # -> NakedEdges, InteriorEdges, NonManifoldEdges
