# Grasshopper definition 211013_RobotMove1mTcp_PA.gh (Grasshopper 1.0.7)

pt = Point(<point referenced from the Rhino model>)
fabrication = GhPythonScript(rotation_pt=pt, rotation_u=Slider(21, range=-45..45), rotation_v=Slider(4, range=-45..45))  # -> out, plane; inputs rotation_pt: Point3d
# ---------- fabrication: Python ----------
import Rhino.Geometry as rg
import simple_comm as c
import simple_ur_script as ur

import math as m

###### plane ######

z_vec = rg.Point3d(0,0,0) - rotation_pt

y_vec = rg.Vector3d(0,0,1)

x_vec = rg.Vector3d.CrossProduct(y_vec, z_vec)

plane = rg.Plane(rotation_pt, x_vec, y_vec)


plane.Rotate(m.radians(rotation_u), plane.XAxis, plane.Origin)

plane.Rotate(m.radians(rotation_v), plane.YAxis, plane.Origin)



script = ""

script += ur.set_tcp_by_angles(
    float(0.0), float(0.0), float(1000.0), m.radians(0.0), m.radians(180.0), m.radians(0))


robot_way_planes = []




safe_vel = 0.05     # m/s
safe_accel = 0.05   # m/s2




script += ur.move_l(plane, safe_accel, safe_vel)

script = c.concatenate_script(script)
print script 

send = False
if send:
    c.send_script(script, "192.168.10.10")
# ---------- end fabrication ----------
geo = Geometry(fabrication.plane)
deplane = DeconstructPlane(Plane=geo)  # -> Origin, XAxis, YAxis, ZAxis
vdis = VectorDisplay(Anchor=deplane.Origin, Vector=deplane.ZAxis)
