# Grasshopper definition 05_SubDiv Components.ghx (Grasshopper 1.0.7)
# plug-ins: Subdivision Info

number_slider = Slider(1, range=0..1)
mesh_box = MeshBox(
    Base={Plane=PlaneXY(0, 0, 0), X=Domain(-10, 10), Y=Domain(-10, 10), Z=Domain(-10, 10)},
    XCount=number_slider,
    YCount=number_slider,
    ZCount=number_slider)
subdivision_catmull = SubdivisionCatmull(Mesh=mesh_box, FacesExtrusion=Slider(0, range=0..10))  # -> Mesh, FacesGroup, VerticesLocked, VerticesGeneration

# ---- group: split faces to their centers
subdivision = Subdivision(Mesh=subdivision_catmull.Mesh, FacesGroup=subdivision_catmull.FacesGroup, VerticesLocked=False, VerticesGeneration=1)  # -> Mesh, FacesGroup, VerticesLocked, VerticesGeneration

# ----
face_analyse = FaceAnalyse(Mesh=subdivision.Mesh)  # -> Mesh, Values
bounds = Bounds(Numbers=face_analyse.Values)
remap_numbers = RemapNumbers(Value=face_analyse.Values, Source=bounds, Target="0 To 20")  # -> Mapped, Clipped
subdivision_taper = SubdivisionTaper(
    Mesh=face_analyse.Mesh,
    FacesExtrusion=remap_numbers.Mapped,
    FacesInset=0.25,
    FacesClose=Toggle(False),
    FacesGroup=subdivision.FacesGroup,
    VerticesLocked=False,
    VerticesGeneration=1)  # -> Mesh, FacesGroup, VerticesLocked, VerticesGeneration
mesh_colorise = MeshColorise(Mesh=subdivision_taper.Mesh, Values=subdivision_taper.FacesGroup)
offset = Offset(Mesh=mesh_colorise, Offset=1)
subdivision_catmull_2 = SubdivisionCatmull(Mesh=offset)  # -> Mesh, FacesGroup, VerticesLocked, VerticesGeneration
subdivision_catmull_3 = SubdivisionCatmull(Mesh=subdivision_catmull_2.Mesh)  # -> Mesh, FacesGroup, VerticesLocked, VerticesGeneration
face_analyse_2 = FaceAnalyse(Mesh=subdivision_catmull_3.Mesh)  # -> Mesh, Values
subdivision_pyramide = SubdivisionPyramide(
    Mesh=subdivision_catmull_3.Mesh,
    FacesExtrusion=face_analyse_2.Values,
    FacesGroup=1,
    VerticesLocked=False,
    VerticesGeneration=1)  # -> Mesh, FacesGroup, VerticesLocked, VerticesGeneration
