# Grasshopper definition 211101_FabricationClassTutorial_PA.ghx (Grasshopper 1.0.7)

pt = Point(Point(9.201915809, 5.177754377, 0))
xy = XYPlane(Origin=pt)
python = GhPythonScript(position=xy)  # -> out, brick_mesh, brick_plane
# ---------- python: Python ----------
import imp
import Rhino.Geometry as rg
import math as m

import brickFunktions as b


imp.reload(b)

brick_pts = b.brick(position)
brick_surfaces = b.surface(brick_pts) 
brick_mesh = b.mesh(brick_pts)
print brick_mesh
brick_plane = b.plane(position)
# ---------- end python ----------
geo = Geometry(python.brick_plane)
geo_2 = Geometry(python.brick_mesh)
python_2 = GhPythonScript()  # -> Out, A
